# Grasshopper definition anySurfaceCalculation.gh (Grasshopper 1.0.7)
# plug-ins: SpaceFactory

number_slider = Slider(50, range=0..100)
unit_z = UnitZ(Factor=1)
surface = Surface(<surface referenced from the Rhino model>)
contour = Contour(Shape=surface, Point=Point(0, 0, 0), Direction=unit_z, Distance=Slider(100, range=0..100))
divide_surface = DivideSurface(Surface=surface, UCount=number_slider, VCount=number_slider)  # -> Points, Normals, Parameters
uvtocontours = UVtoContours(
    Contours=flatten(contour),
    Points=flatten(divide_surface.Points),
    Normals=flatten(divide_surface.Normals),
    Length=Slider(200, range=0..1000))  # -> Points, Normals
mapnormal = MapNormal(Points=uvtocontours.Points, Normals=uvtocontours.Normals, Threshold=Slider(30, range=0..100), Support=Toggle(True))  # -> PositivePoints, PositiveAngles, NegativePoints, NegativeAngles
point = Point(mapnormal.NegativePoints)
point_2 = Point(mapnormal.PositivePoints)
